# Grasshopper definition hb_RhinoToRevit.gh (Grasshopper 0.9.76)
# plug-ins: Hummingbird, Human, PTComponentLibrary, LunchBox

# ---- group: Building 1 Glass Brep
brep = Brep([<brep referenced from the Rhino model> x333])

# ---- group: Building 1 Glass Railing Brep
brep_2 = Brep([<brep referenced from the Rhino model> x147])

# ---- group: TEST: Project surface to plane and extract projected curves
brep_3 = Brep(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)
brep_4 = Brep([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])
debrep = DeconstructBrep(Brep=brep_3)  # -> Faces, Edges, Vertices
item = ListItem(List=debrep.Faces, Index=Slider(1, range=1..3), Wrap=True)
srf = Surface(item)
project = Project(Geometry=brep_4, Plane=srf)  # -> Geometry, Transform
debrep_2 = DeconstructBrep(Brep=project.Geometry)  # -> Faces, Edges, Vertices
crv = Curve(debrep_2.Faces)
panel = Panel(crv)
list = ItemSelector(crv, {"Polyline Curve", "Polyline Curve", "Closed Planar Curve"}, selected=[])

# ----
brep_5 = Brep(<brep referenced from the Rhino model>)
join = BrepJoin(Breps=brep_5)  # -> Breps, Closed
panel_2 = Panel(join.Breps)

# ---- group: Floor Slabs / Building 1 Brep
# Verify that there are no duplicate
# elements in the same place in the Rhino
# model.  For example, 2 identical slabs in
# the same place.
brep_6 = Brep([<brep referenced from the Rhino model> x44])

# ---- group: Floor Slabs / Building 2 Brep
brep_7 = Brep([<brep referenced from the Rhino model> x89])

# ---- group: Floor Slabs / Building 3 Brep
brep_8 = Brep([<brep referenced from the Rhino model> x52])

# ---- group: Floor Slabs / Building 4 (Pavilion) Brep
brep_9 = Brep([<brep referenced from the Rhino model> x8])

# ---- group: Building 1 Glass Brep
brep_10 = Brep([<brep referenced from the Rhino model> x333])

# ---- group: Building 1 Glass Railing Brep
brep_11 = Brep([<brep referenced from the Rhino model> x147])

# ----
# This instance has the correct methodology
# for extracting surfaces from the floor plates.
brep_12 = Brep([join.Breps, brep_6])

# ---- group: Reference all floors into a single BRep from Rhino Model / Building 1 Brep
# FLOORS &
# LEVELS
brep_13 = Brep([<brep referenced from the Rhino model> x45])

# ---- group: Reference all floors into a single BRep from Rhino Model / Building 2 Brep
brep_14 = Brep([<brep referenced from the Rhino model> x89])

# ---- group: Reference all floors into a single BRep from Rhino Model / Building 3 Brep
brep_15 = Brep([<brep referenced from the Rhino model> x52])

# ---- group: Reference all floors into a single BRep from Rhino Model / Building 4 Brep
brep_16 = Brep([<brep referenced from the Rhino model> x8])

# ---- group: Sample Geometry
brep_17 = Brep([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])

# ----
debrep_3 = DeconstructBrep(Brep=brep_10)  # -> Faces, Edges, Vertices

# ---- group: Reference a single BRep from Rhino Model / Lower Mass
# GRIDS
brep_18 = Brep(<brep referenced from the Rhino model>)

# ---- group: Reference a single BRep from Rhino Model / Upper Mass
brep_19 = Brep(<brep referenced from the Rhino model>)

# ---- group: Attach Brep Here
brep_20 = Brep(brep_12)

# ----
edges = BrepEdges(Brep=brep_10)  # -> Naked, Interior, NonManifold

# ---- group: Building 1 Glass Brep
brep_21 = Brep([<brep referenced from the Rhino model> x333])

# ---- group: Building 1 Glass Railing Brep
brep_22 = Brep([<brep referenced from the Rhino model> x147])

# ----
join_2 = BrepJoin()  # -> Breps, Closed

# ---- group: Attach Brep Here
# CORE - Large
project_2 = Project(Plane=PlaneXY(0, 0, 0))  # -> Geometry, Transform

# ----
Z = UnitZ(Factor=debrep_3.Edges)
X = UnitX(Factor=debrep_3.Edges)
panel_3 = Panel(debrep_3.Edges)

# ---- group: Attach Brep Here
# Verify that there are no
# duplicate elements in the
# same place in the Rhino
# model.  For example, 2
# identical slabs in the same
# place.
brep_23 = Brep(brep_13)

# ----
crv_2 = Curve(edges.Naked)
crv_3 = Curve(edges.Interior)
debrep_4 = DeconstructBrep(Brep=brep_21)  # -> Faces, Edges, Vertices

# ---- group: Modify grid offset from perimeter
y_axis_offset = Slider(3.1, range=0..5)
x_axis_offset = Slider(4.1, range=0..5)

# ----
panel_4 = Panel(X)

debrep_5 = DeconstructBrep(Brep=brep_23)  # -> Faces, Edges, Vertices
boxprop = BoxProperties(Box=brep_23)  # -> Center, Diagonal, Area, Volume, Degeneracy
division = Division(A=boxprop.Volume, B=boxprop.Area)
division_2 = Division(A=division, B="2")
vec = VectorXYZ(XComponent=0, YComponent=0, ZComponent=division_2)  # -> Vector, Length
move = Move(Geometry=boxprop.Center, Motion=vec.Vector)  # -> graft(Geometry), Transform
Z_2 = UnitZ(Factor=1)
project_3 = ProjectPoint(Point=move.Geometry, Direction=Z_2, Geometry=debrep_5.Faces)  # -> Point, Index
item_2 = ListItem(List=debrep_5.Faces, Index=project_3.Index, Wrap=True)
srf_2 = Surface(item_2)
srf_3 = Surface(flatten(srf_2))
join_3 = BrepJoin(Breps=srf_3)  # -> Breps, Closed
srf_4 = Surface(join_3.Breps)

edges_2 = BrepEdges(Brep=brep_21)  # -> Naked, Interior, NonManifold
brep_24 = Brep([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])

brep_25 = Brep([<brep referenced from the Rhino model> x87])
debrep_6 = DeconstructBrep(Brep=brep_25)  # -> Faces, Edges, Vertices
pt = Point(debrep_6.Vertices)
panel_5 = Panel(pt)
panel_6 = Panel("C:\Users\hans.palacios\Documents\My Files\01_DTM\Tickets\20170208 - Rhino To Revit\RhinoExport")
loftforms = LoftForms(WriteToggle=Toggle(False), FolderPath=panel_6, CsvFileName="wallsPrecast", Points=pt, LoftMode=1)  # -> Output, Data
panel_7 = Panel(loftforms.Data)
panel_8 = Panel(loftforms.Output)

brep_26 = Brep([<brep referenced from the Rhino model> x528])
Z_3 = UnitZ(Factor=debrep_4.Edges)
brep_27 = Brep([<brep referenced from the Rhino model> x5])
X_2 = UnitX(Factor=debrep_4.Edges)
debrep_7 = DeconstructBrep(Brep=brep_24)  # -> Faces, Edges, Vertices
boxprop_2 = BoxProperties(Box=brep_24)  # -> Center, Diagonal, Area, Volume, Degeneracy
panel_9 = Panel(debrep_4.Edges)
panel_10 = Panel(debrep_4.Vertices)
crv_4 = Curve(edges_2.Naked)
crv_5 = Curve(edges_2.Interior)
debrep_8 = DeconstructBrep(Brep=brep_27)  # -> Faces, Edges, Vertices
division_3 = Division(A=boxprop_2.Volume, B=boxprop_2.Area)
panel_11 = Panel(X_2)
division_4 = Division(A=division_3, B="2")
pt_2 = Point(debrep_8.Vertices)
crv_6 = Curve(debrep_8.Edges)
srf_5 = Surface(debrep_8.Faces)

# ----
# GRIDS
# Process to create grid from points
boxprop_3 = BoxProperties(Box=brep_20)  # -> Center, Diagonal, Area, Volume, Degeneracy
pt_3 = Point(boxprop_3.Center)
pdecon = Deconstruct(Point=pt_3)  # -> XComponent, YComponent, ZComponent
sort = SortList(Keys=pdecon.ZComponent, ValuesA=brep_20)  # -> Keys, ValuesA
item_3 = ListItem(List=flatten(sort.ValuesA), Index="0", Wrap=True)
project_4 = Project(Geometry=item_3, Plane=PlaneXY(0, 0, 0))  # -> Geometry, Transform
box_corners = BoxCorners(Box=project_4.Geometry)  # -> CornerA, CornerB, CornerC, CornerD, CornerE, CornerF, CornerG, CornerH
grid = Slider(6, range=0..15)
ln = Line(StartPoint=box_corners.CornerA, EndPoint=box_corners.CornerB)
ln_2 = Line(StartPoint=box_corners.CornerB, EndPoint=box_corners.CornerC)
ln_3 = Line(StartPoint=box_corners.CornerC, EndPoint=box_corners.CornerD)
grid_2 = Slider(19, range=0..40)
arrcurve = CurveArray(Geometry=ln_2, Curve=ln_3, Count=grid)  # -> Geometry, Transform
extension = Slider(12, range=0..15)
arrcurve_2 = CurveArray(Geometry=ln, Curve=ln_2, Count=grid_2)  # -> Geometry, Transform
ext = ExtendCurve(Curve=[arrcurve_2.Geometry, arrcurve.Geometry], Type=0, Start=extension, End=extension)

vec_2 = VectorXYZ(XComponent=0, YComponent=0, ZComponent=division_4)  # -> Vector, Length
project_5 = Project(Curve=brep_21, Brep=srf_4, Direction=Vector(0, 0, 1))
panel_12 = Panel(brep_21)

# ---- group: Graft to add branch to align with other tree
move_2 = Move(Geometry=boxprop_2.Center, Motion=vec_2.Vector)  # -> graft(Geometry), Transform

# ----
cp = ControlPoints(Curve=crv_6)  # -> Points, Weights, Knots
walls = Walls()  # -> Output, Data
Z_4 = UnitZ(Factor=1)
panel_13 = Panel("C:\Users\hans.palacios\Documents\My Files\01_DTM\Tickets\20170208 - Rhino To Revit\RhinoExport")
project_6 = ProjectPoint(Point=move_2.Geometry, Direction=Z_4, Geometry=debrep_7.Faces)  # -> Point, Index
panel_14 = Panel(cp.Points)

# ---- group: True - Export
toggle = BooleanToggle(False)

# ----
panel_15 = Panel(move_2.Geometry)
panel_16 = Panel("C:\Users\hans.palacios\Documents\My Files\01_DTM\Tickets\20170208 - Rhino To Revit\RhinoExport")
item_4 = ListItem(List=debrep_7.Faces, Index=project_6.Index, Wrap=True)

# ---- group: Modify number of grids along axis
y_axis_grid = Slider(5, range=0..15)
x_axis_grid = Slider(14, range=0..40)

# ---- group: Modify to extend grid end points
grid_line_extension = Slider(4, range=0..15)

# ----
panel_17 = Panel(project_6.Index)
srf_6 = Surface(item_4)
loftforms_2 = LoftForms(WriteToggle=toggle, FolderPath=panel_13, CsvFileName="glazing2", Points=cp.Points, LoftMode=1)  # -> Output, Data

# ---- group: True - Export
toggle_2 = BooleanToggle(False)

# ----
panel_18 = Panel(loftforms_2.Output)
panel_19 = Panel(loftforms_2.Data)

# ---- group: Floor1 - Extract curves from surfaces & join individual curves into closed curves per level
edges_3 = BrepEdges(Brep=srf_4)  # -> Naked, Interior, NonManifold
crv_7 = Curve(edges_3.Naked)
join_4 = JoinCurves(Curves=crv_7, Preserve=Toggle(False))
trim = TrimTree(Tree=join_4, Depth=1)
simplify = SimplifyCurve(Curve=trim)  # -> Curve, Simplified

# ---- group: Level1 - Extract points from surfaces & isolate Z coordinate to identify level above ground plane
srfpt = SurfacePoints(Surface=srf_4)  # -> Points, Weights, Greville, UCount, VCount
panel_20 = Panel("""True
False
False
False""")
dispatch = Dispatch(List=srfpt.Points, DispatchPattern=panel_20)  # -> ListA, ListB
pdecon_2 = Deconstruct(Point=dispatch.ListA)  # -> XComponent, YComponent, ZComponent
Z_5 = UnitZ(Factor=pdecon_2.ZComponent)
vlen = VectorLength(Vector=Z_5)
trim_2 = TrimTree(Tree=vlen, Depth=1)
dcon = DeleteConsecutive(Set=trim_2, Wrap=False)  # -> Set, Count
trunc = Truncate(Input=dcon.Set, TruncationFactor=0)

# ----
path = ConstructPath()
partition = PartitionList(Size=[3, 2])

# ---- group: Define file path location
panel_21 = Panel("C:\Users\hans.palacios\Documents\My Files\01_DTM\Tickets\20170208 - Rhino To Revit\RhinoExport")

# ----
panel_22 = Panel(pdecon_2.ZComponent)

# ---- group: File name (.csv)
panel_23 = Panel("grid1")
panel_24 = Panel("grid2")
panel_25 = Panel("grid3")
panel_26 = Panel("grid4")

# ---- group: Set to True to Export
toggle_3 = BooleanToggle(False)

# ---- group: Grid Distances
item_5 = ListItem(List=flatten(arrcurve_2.Geometry), Index=0, Wrap=True)
item_6 = ListItem(List=flatten(arrcurve_2.Geometry), Index=1, Wrap=True)
item_7 = ListItem(List=flatten(arrcurve.Geometry), Index=0, Wrap=True)
item_8 = ListItem(List=flatten(arrcurve.Geometry), Index=1, Wrap=True)
end = EndPoints(Curve=item_5)  # -> Start, End
end_2 = EndPoints(Curve=item_6)  # -> Start, End
end_3 = EndPoints(Curve=item_7)  # -> Start, End
end_4 = EndPoints(Curve=item_8)  # -> Start, End
dist = Distance(PointA=end.Start, PointB=end_2.Start)
dist_2 = Distance(PointA=end_3.Start, PointB=end_4.Start)
panel_27 = Panel(dist)
panel_28 = Panel(dist_2)

# ----
line = Line(ext)

# ---- group: Level1 - Extract number of floors & use as Level Names (Add 1 to shift index from 0)
trim_3 = TrimTree(Tree=simplify.Curve, Depth=1)
lng = ListLength(List=trim_3)
series = Series(Start=0, Step=1, Count=lng)
addition = Addition(A=series, B="1")
concat = Concatenate(FragmentA="Level ", FragmentB=addition)
unflatten = UnflattenTree(Tree=concat, Guide=simplify.Curve)
trim_4 = TrimTree(Tree=unflatten, Depth=1)
panel_29 = Panel(trim_4)

# ---- group: True - Export
toggle_4 = BooleanToggle(False)

# ---- group: Level1 - Export
# This has to be grafted because the
# curve list is flattened.  This
# allows the grids to be created.
panel_30 = Panel("C:\Users\hans.palacios\Documents\My Files\01_DTM\Tickets\20170208 - Rhino To Revit\RhinoExport")
grids = Grids(WriteToggle=toggle_4, FolderPath=panel_30, CsvFileName="grid1", Curves=graft(line))  # -> Output, Data
panel_34 = Panel(grids.Output)
panel_35 = Panel(grids.Data)

# ---- group: Define file path location
panel_36 = Panel("C:\Users\hans.palacios\Documents\My Files\01_DTM\Tickets\20170208 - Rhino To Revit\RhinoExport")

panel_37 = Panel("C:\Users\hans.palacios\Documents\My Files\01_DTM\Tickets\20170208 - Rhino To Revit\RhinoExport")

# ---- group: File name (.csv)
panel_38 = Panel("floors1")
panel_39 = Panel("floors2")
panel_40 = Panel("floors3")
panel_41 = Panel("floors4")

panel_42 = Panel("levels1")
panel_43 = Panel("levels2")
panel_44 = Panel("levels4")
panel_45 = Panel("levels3")

# ---- group: Set to True to Export
toggle_5 = BooleanToggle(False)

toggle_6 = BooleanToggle(False)

# ---- group: Revit floor type
panel_46 = Panel("Concrete Slab")

# ----
# GRIDS
# Grid Creation
number_slider = Slider(25, range=0..50)
series_2 = Series(Start=0, Step=number_slider, Count=Slider(13, range=0..50))
series_3 = Series(Start=0, Step=Slider(25, range=0..50), Count=Slider(18, range=0..50))
line_2 = Line(Line((-2897.995339, -6488.924805, 0), (-2593.444025, -6488.924805, 0)))
X_3 = UnitX(Factor=series_2)
Y = UnitY(Factor=series_3)
end_5 = EndPoints(Curve=line_2)  # -> Start, End
move_3 = Move(Geometry=line_2, Motion=Y)  # -> Geometry, Transform
item_9 = ListItem(List=move_3.Geometry, Index="-1", Wrap=True)
end_6 = EndPoints(Curve=item_9)  # -> Start, End
ln_4 = Line(StartPoint=end_5.Start, EndPoint=end_6.Start)
move_4 = Move(Geometry=ln_4, Motion=X_3)  # -> Geometry, Transform

# ---- group: Export levels to CSV file
levels = Levels(WriteToggle=toggle_5, FolderPath=panel_37, CsvFileName=panel_42, LevelElevation=trunc, LevelName=trim_4)  # -> Output, Data
panel_47 = Panel(levels.Data)
panel_48 = Panel(levels.Output)

# ---- group: Export floors to CSV file
floors = Floors(WriteToggle=toggle_6, FolderPath=panel_36, CsvFileName=panel_38, RevitTypeName=panel_46, DataTreeSource=simplify.Curve)  # -> Output, Data
panel_49 = Panel(floors.Output)
panel_50 = Panel(floors.Data)

# ---- group: True - Export
toggle_7 = BooleanToggle(False)

# ----
panel_51 = Panel("C:\Users\hans.palacios\Documents\My Files\01_DTM\Tickets\20170208 - Rhino To Revit\RhinoExport")

# ---- group: True - Export
toggle_8 = BooleanToggle(False)

# ---- group: Original Pass / True - Export
toggle_9 = BooleanToggle(False)

toggle_10 = BooleanToggle(False)

# ---- group: TEST: Project surface to plane and extract projected curves
brep_28 = Brep([<brep referenced from the Rhino model> x12])
brep_29 = Brep([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])
debrep_9 = DeconstructBrep(Brep=brep_28)  # -> Faces, Edges, Vertices
item_10 = ListItem(List=debrep_9.Faces, Index=Slider(1, range=1..3), Wrap=True)
srf_7 = Surface(item_10)
project_7 = Project(Geometry=brep_29, Plane=srf_7)  # -> Geometry, Transform
debrep_10 = DeconstructBrep(Brep=project_7.Geometry)  # -> Faces, Edges, Vertices
crv_8 = Curve(debrep_10.Faces)

# ----
list_2 = ItemSelector(
    brep_29,
    {"Trimmed Surface", "Open Brep", "Trimmed Surface", "Trimmed Surface", "Open Brep", "Trimmed Surface", "Trimmed Surface", "Open Brep", "Trimmed Surface"}, selected="Trimmed Surface")
panel_52 = Panel(brep_29)
list_3 = ItemSelector(
    srf_7,
    {"Trimmed Surface", "Trimmed Surface", "Trimmed Surface", "Trimmed Surface", "Trimmed Surface", "Trimmed Surface", "Trimmed Surface", "Trimmed Surface", "Trimmed Surface", "Trimmed Surface", "Trimmed Surface", "Trimmed Surface"}, selected="Trimmed Surface")
panel_53 = Panel(srf_7)
crv_9 = Curve(debrep_10.Faces)
trim_5 = TrimTree(Tree=crv_9, Depth=1)  # -> flatten(Tree)
sort_crv = SortDuplicateCurves(Curves=trim_5)  # -> UniqueCurves, Indices
panel_54 = Panel(project_7.Geometry)

# ---- group: TEST: Project surface to plane and extract projected curves (continued)
list_4 = ItemSelector(
    sort_crv.UniqueCurves,
    {"Closed Planar Curve", "Polyline Curve", "Polyline Curve", "Closed Planar Curve", "Closed Planar Curve", "Polyline Curve", "Polyline Curve", "Closed Planar Curve", "Closed Planar Curve", "Polyline Curve"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}, selected="Closed Planar Curve")
panel_55 = Panel(sort_crv.UniqueCurves)

# ----
x_tremez = Extremes(Curve=trim_5, Plane=PlaneXY(0, 0, 0))  # -> Highest, Lowest
pdecon_3 = Deconstruct(Point=x_tremez.Lowest)  # -> XComponent, YComponent, ZComponent
panel_56 = Panel(trim_5)
sort_val = SortDuplicateValues(ValueList=pdecon_3.ZComponent)  # -> UniqueValues, Indices
panel_57 = Panel(pdecon_3.ZComponent)
panel_58 = Panel(sort_val.Indices)
panel_59 = Panel(sort_val.UniqueValues)
lng_2 = ListLength(List=sort_val.Indices)
partition_2 = PartitionList(List=flatten(trim_5), Size=lng_2)  # -> simplify(Chunks)
panel_60 = Panel(partition_2)

brep_30 = Brep(<brep referenced from the Rhino model>)
debrep_11 = DeconstructBrep(Brep=brep_30)  # -> Faces, Edges, Vertices
boxprop_4 = BoxProperties(Box=brep_30)  # -> Center, Diagonal, Area, Volume, Degeneracy
division_5 = Division(A=boxprop_4.Volume, B=boxprop_4.Area)
division_6 = Division(A=division_5, B="2")
vec_3 = VectorXYZ(XComponent=0, YComponent=0, ZComponent=division_6)  # -> Vector, Length

# ---- group: Graft to add branch to align with other tree
move_5 = Move(Geometry=boxprop_4.Center, Motion=vec_3.Vector)  # -> Geometry, Transform

# ----
project_8 = ProjectPoint(Point=move_5.Geometry, Direction=Vector(0, 0, -1), Geometry=debrep_11.Faces)  # -> Point, Index
panel_61 = Panel(move_5.Geometry)
item_11 = ListItem(List=debrep_11.Faces, Index=project_8.Index, Wrap=True)
panel_62 = Panel(project_8.Index)
srf_8 = Surface(item_11)
edges_4 = BrepEdges(Brep=srf_8)  # -> graft(Naked), Interior, NonManifold

crv_10 = Curve(edges_4.Naked)
walls_2 = Walls(WriteToggle=toggle_2, FolderPath=panel_16, CsvFileName="core2", Curves=crv_10, RevitTypeName="Core Wall")  # -> Output, Data
panel_63 = Panel(walls_2.Data)
panel_64 = Panel(walls_2.Output)

debrep_12 = DeconstructBrep(Brep=brep_20)  # -> Faces, Edges, Vertices
boxprop_5 = BoxProperties(Box=brep_20)  # -> Center, Diagonal, Area, Volume, Degeneracy
division_7 = Division(A=boxprop_5.Volume, B=boxprop_5.Area)
division_8 = Division(A=division_7, B="2")
vec_4 = VectorXYZ(XComponent=0, YComponent=0, ZComponent=division_8)  # -> Vector, Length
Z_6 = UnitZ(Factor=1)

# ---- group: Graft to add branch to align with other tree
move_6 = Move(Geometry=boxprop_5.Center, Motion=vec_4.Vector)  # -> graft(Geometry), Transform

# ----
project_9 = ProjectPoint(Point=move_6.Geometry, Direction=Z_6, Geometry=debrep_12.Faces)  # -> Point, Index
panel_65 = Panel(move_6.Geometry)
item_12 = ListItem(List=debrep_12.Faces, Index=project_9.Index, Wrap=True)
panel_66 = Panel(project_9.Index)
srf_9 = Surface(item_12)

# ----
# This has to be flattened because the
# surface list from the previous process
# was grafted 1 tree branch too much.  This
# allows the levels to be created.
srf_10 = Surface(flatten(srf_9))
panel_67 = Panel(srf_10)
join_5 = BrepJoin(Breps=srf_10)  # -> Breps, Closed
srf_11 = Surface(join_5.Breps)
clean = CleanTree(RemoveNulls=True, RemoveInvalid=True, RemoveEmpty=False, Tree=srf_11)
panel_68 = Panel(clean)

# ---- group: Level1 - Extract points from surfaces & isolate Z coordinate to identify level above ground plane
srfpt_2 = SurfacePoints(Surface=srf_11)  # -> Points, Weights, Greville, UCount, VCount
panel_69 = Panel("""True
False
False
False""")
dispatch_2 = Dispatch(List=srfpt_2.Points, DispatchPattern=panel_69)  # -> ListA, ListB
pdecon_4 = Deconstruct(Point=dispatch_2.ListA)  # -> XComponent, YComponent, ZComponent
Z_7 = UnitZ(Factor=pdecon_4.ZComponent)
vlen_2 = VectorLength(Vector=Z_7)
trim_6 = TrimTree(Tree=vlen_2, Depth=1)
panel_70 = Panel(trim_6)

# ---- group: Floor1 - Extract curves from surfaces & join individual curves into closed curves per level
edges_5 = BrepEdges(Brep=srf_11)  # -> Naked, Interior, NonManifold
crv_11 = Curve(edges_5.Naked)
join_6 = JoinCurves(Curves=crv_11, Preserve=Toggle(False))
trim_7 = TrimTree(Tree=join_6, Depth=1)
simplify_2 = SimplifyCurve(Curve=trim_7)  # -> Curve, Simplified
panel_71 = Panel(simplify_2.Curve)

# ----
dcon_2 = DeleteConsecutive(Set=trim_6, Wrap=False)  # -> Set, Count
trunc_2 = Truncate(Input=dcon_2.Set, TruncationFactor=0)

# ---- group: Level1 - Extract number of floors & use as Level Names (Add 1 to shift index from 0)
trim_8 = TrimTree(Tree=simplify_2.Curve, Depth=1)
lng_3 = ListLength(List=trim_8)
series_4 = Series(Start=0, Step=1, Count=lng_3)
addition_2 = Addition(A=series_4, B="1")
concat_2 = Concatenate(FragmentA="Level ", FragmentB=addition_2)
unflatten_2 = UnflattenTree(Tree=concat_2, Guide=simplify_2.Curve)
trim_9 = TrimTree(Tree=unflatten_2, Depth=1)
panel_72 = Panel(trim_9)

# ----
panel_73 = Panel(trunc_2)

# ---- group: Floor1 - Export
panel_75 = Panel("C:\Users\hans.palacios\Documents\My Files\01_DTM\Tickets\20170208 - Rhino To Revit\RhinoExport")
floors_2 = Floors(
    WriteToggle=Toggle(False),
    FolderPath=panel_75,
    CsvFileName="floors1",
    RevitTypeName="Concrete Slab",
    DataTreeSource=simplify_2.Curve)  # -> Output, Data
panel_79 = Panel(floors_2.Output)
panel_80 = Panel(floors_2.Data)

# ----
item_13 = ListItem(List=trunc_2, Index="-1", Wrap=True)
panel_81 = Panel(item_13)

# ---- group: Level1 - Export
panel_82 = Panel("C:\Users\hans.palacios\Documents\My Files\01_DTM\Tickets\20170208 - Rhino To Revit\RhinoExport")
levels_2 = Levels(WriteToggle=toggle_7, FolderPath=panel_82, CsvFileName="levels1", LevelElevation=trunc_2, LevelName=trim_9)  # -> Output, Data
panel_86 = Panel(levels_2.Data)
panel_87 = Panel(levels_2.Output)

# ----
box_corners_2 = BoxCorners(Box=project_2.Geometry)  # -> CornerA, CornerB, CornerC, CornerD, CornerE, CornerF, CornerG, CornerH
ln_5 = Line(StartPoint=box_corners_2.CornerB, EndPoint=box_corners_2.CornerA)
ln_6 = Line(StartPoint=box_corners_2.CornerC, EndPoint=box_corners_2.CornerB)
ln_7 = Line(StartPoint=box_corners_2.CornerD, EndPoint=box_corners_2.CornerC)
offset = Offset(Curve=[ln_5, ln_7], Distance=x_axis_offset, Plane=PlaneXY(0, 0, 0), Corners=x_axis_offset)  # -> flatten(Curve)

ln_8 = Line(StartPoint=box_corners_2.CornerA, EndPoint=box_corners_2.CornerD)

offset_2 = Offset(Curve=[ln_6, ln_8], Distance=y_axis_offset, Plane=PlaneXY(0, 0, 0), Corners=y_axis_offset)  # -> flatten(Curve)
ptuvcrvs = IntersectCurves(CU=offset_2, CV=offset)
dispatch_3 = Dispatch(List=ptuvcrvs, DispatchPattern=[True, False])  # -> flatten(ListA), flatten(ListB)
dispatch_4 = Dispatch(List=ptuvcrvs, DispatchPattern=[True, False])  # -> ListA, ListB
dispatch_5 = Dispatch(List=[dispatch_3.ListA, dispatch_3.ListB], DispatchPattern=[True, False])  # -> ListA, ListB
ln_9 = Line(StartPoint=dispatch_4.ListA, EndPoint=dispatch_4.ListB)  # -> flatten(Line)
ln_10 = Line(StartPoint=dispatch_5.ListA, EndPoint=dispatch_5.ListB)  # -> flatten(Line)
dispatch_6 = Dispatch(List=ln_9, DispatchPattern=[True, False])  # -> ListA, ListB
dispatch_7 = Dispatch(List=ln_10, DispatchPattern=[True, False])  # -> ListA, ListB
crv_12 = Curve(dispatch_7.ListA)
crv_13 = Curve(dispatch_7.ListB)
crv_14 = Curve(dispatch_6.ListA)
crv_15 = Curve(dispatch_6.ListB)
arrcurve_3 = CurveArray(Geometry=crv_14, Curve=crv_13, Count=y_axis_grid)  # -> Geometry, Transform
arrcurve_4 = CurveArray(Geometry=crv_12, Curve=crv_15, Count=x_axis_grid)  # -> Geometry, Transform
ext_2 = ExtendCurve(Curve=[arrcurve_4.Geometry, arrcurve_3.Geometry], Type=0, Start=grid_line_extension, End=grid_line_extension)

# ---- group: Grid Distances
item_14 = ListItem(List=arrcurve_3.Geometry, Index=0, Wrap=True)
item_15 = ListItem(List=arrcurve_3.Geometry, Index=1, Wrap=True)
item_16 = ListItem(List=arrcurve_4.Geometry, Index=0, Wrap=True)
item_17 = ListItem(List=arrcurve_4.Geometry, Index=1, Wrap=True)
end_7 = EndPoints(Curve=item_14)  # -> Start, End
end_8 = EndPoints(Curve=item_15)  # -> Start, End
end_9 = EndPoints(Curve=item_16)  # -> Start, End
end_10 = EndPoints(Curve=item_17)  # -> Start, End
dist_3 = Distance(PointA=end_7.Start, PointB=end_8.Start)
dist_4 = Distance(PointA=end_9.Start, PointB=end_10.Start)

# ---- group: Export grids to CSV file
# This has to be grafted because the
# curve list is flattened.  This
# allows the grids to be created.
line_3 = Line(ext_2)
grids_2 = Grids(WriteToggle=toggle_3, FolderPath=panel_21, CsvFileName=panel_23, Curves=graft(line_3))  # -> Output, Data
panel_88 = Panel(grids_2.Output)
panel_89 = Panel(grids_2.Data)

# ---- group: Distance between y-axis grids
panel_90 = Panel(dist_3)

# ---- group: Distance between x-axis grids
panel_91 = Panel(dist_4)

# ---- group: Original Pass
brep_31 = Brep([<brep referenced from the Rhino model> x19])
debrep_13 = DeconstructBrep(Brep=brep_31)  # -> Faces, Edges, Vertices
boxprop_6 = BoxProperties(Box=brep_31)  # -> Center, Diagonal, Area, Volume, Degeneracy
division_9 = Division(A=boxprop_6.Volume, B=boxprop_6.Area)
division_10 = Division(A=division_9, B="2")
vec_5 = VectorXYZ(XComponent=0, YComponent=0, ZComponent=division_10)  # -> Vector, Length
Z_8 = UnitZ(Factor=1)

# ---- group: Original Pass / Graft to add branch to align with other tree
move_7 = Move(Geometry=boxprop_6.Center, Motion=vec_5.Vector)  # -> graft(Geometry), Transform

# ---- group: Original Pass (continued)
project_10 = ProjectPoint(Point=move_7.Geometry, Direction=Z_8, Geometry=debrep_13.Faces)  # -> Point, Index
panel_92 = Panel(move_7.Geometry)
item_18 = ListItem(List=debrep_13.Faces, Index=project_10.Index, Wrap=True)
panel_93 = Panel(project_10.Index)
srf_12 = Surface(item_18)

# ---- group: Original Pass / Surfaces1 - Surfaces for each floor slab from RH model
srf_13 = Surface(flatten(srf_12))
panel_94 = Panel(srf_13)

# ---- group: Original Pass / Level1 - Extract points from surfaces & isolate Z coordinate to identify level above ground plane
srfpt_3 = SurfacePoints(Surface=srf_13)  # -> Points, Weights, Greville, UCount, VCount
panel_95 = Panel("""True
False
False
False""")
dispatch_8 = Dispatch(List=srfpt_3.Points, DispatchPattern=panel_95)  # -> ListA, ListB
pdecon_5 = Deconstruct(Point=dispatch_8.ListA)  # -> XComponent, YComponent, ZComponent
Z_9 = UnitZ(Factor=pdecon_5.ZComponent)
vlen_3 = VectorLength(Vector=Z_9)
trim_10 = TrimTree(Tree=vlen_3, Depth=1)
panel_96 = Panel(trim_10)

# ---- group: Original Pass / Floor1 - Extract curves from surfaces & join individual curves into closed curves per level
edges_6 = BrepEdges(Brep=srf_13)  # -> Naked, Interior, NonManifold
crv_16 = Curve(edges_6.Naked)
join_7 = JoinCurves(Curves=crv_16, Preserve=Toggle(False))
trim_11 = TrimTree(Tree=join_7, Depth=1)
simplify_3 = SimplifyCurve(Curve=trim_11)  # -> Curve, Simplified
panel_97 = Panel(simplify_3.Curve)

# ---- group: Original Pass / Level1 - Extract number of floors & use as Level Names (Add 1 to shift index from 0)
trim_12 = TrimTree(Tree=simplify_3.Curve, Depth=1)
lng_4 = ListLength(List=trim_12)
series_5 = Series(Start=0, Step=1, Count=lng_4)
addition_3 = Addition(A=series_5, B="1")
concat_3 = Concatenate(FragmentA="Level ", FragmentB=addition_3)
unflatten_3 = UnflattenTree(Tree=concat_3, Guide=simplify_3.Curve)
trim_13 = TrimTree(Tree=unflatten_3, Depth=1)
panel_98 = Panel(trim_13)

# ---- group: Original Pass
# CORE - Small
dcon_3 = DeleteConsecutive(Set=trim_10, Wrap=False)  # -> Set, Count
trunc_3 = Truncate(Input=dcon_3.Set, TruncationFactor=0)
panel_99 = Panel(trunc_3)
toggle_11 = BooleanToggle(False)
item_19 = ListItem(List=trunc_3, Index="-1", Wrap=True)
panel_100 = Panel(item_19)
panel_101 = Panel("C:\Users\hans.palacios\Documents\My Files\01_DTM\Tickets\20170208 - Rhino To Revit\RhinoExport")

# ---- group: Original Pass / Floor1 - Export
panel_102 = Panel("C:\Users\hans.palacios\Documents\My Files\01_DTM\Tickets\20170208 - Rhino To Revit\RhinoExport")
floors_3 = Floors(
    WriteToggle=toggle_11,
    FolderPath=panel_102,
    CsvFileName="floors",
    RevitTypeName="Concrete Slab",
    DataTreeSource=simplify_3.Curve)  # -> Output, Data
panel_103 = Panel(floors_3.Data)
panel_104 = Panel(floors_3.Output)

# ---- group: Original Pass / Level1 - Export
panel_105 = Panel("C:\Users\hans.palacios\Documents\My Files\01_DTM\Tickets\20170208 - Rhino To Revit\RhinoExport")
levels_3 = Levels(WriteToggle=toggle_9, FolderPath=panel_105, CsvFileName="levels", LevelElevation=trunc_3, LevelName=trim_13)  # -> Output, Data
panel_106 = Panel(levels_3.Data)
panel_107 = Panel(levels_3.Output)

# ----
brep_32 = Brep(<brep referenced from the Rhino model>)
# CORE - Large
debrep_14 = DeconstructBrep(Brep=brep_32)  # -> Faces, Edges, Vertices
boxprop_7 = BoxProperties(Box=brep_32)  # -> Center, Diagonal, Area, Volume, Degeneracy
division_11 = Division(A=boxprop_7.Volume, B=boxprop_7.Area)
division_12 = Division(A=division_11, B="2")
vec_6 = VectorXYZ(XComponent=0, YComponent=0, ZComponent=division_12)  # -> Vector, Length

# ---- group: Graft to add branch to align with other tree
move_8 = Move(Geometry=boxprop_7.Center, Motion=vec_6.Vector)  # -> Geometry, Transform

# ----
project_11 = ProjectPoint(Point=move_8.Geometry, Direction=Vector(0, 0, -1), Geometry=debrep_14.Faces)  # -> Point, Index
panel_108 = Panel(move_8.Geometry)
item_20 = ListItem(List=debrep_14.Faces, Index=project_11.Index, Wrap=True)
panel_109 = Panel(project_11.Index)
srf_14 = Surface(item_20)
edges_7 = BrepEdges(Brep=srf_14)  # -> graft(Naked), Interior, NonManifold

crv_17 = Curve(edges_7.Naked)
walls_3 = Walls(
    WriteToggle=toggle_8,
    FolderPath=panel_51,
    CsvFileName="core2",
    Curves=crv_17,
    RevitTypeName="Core Wall",
    RevitWallHeight=item_13)  # -> Output, Data
panel_110 = Panel(walls_3.Data)
panel_111 = Panel(walls_3.Output)

# ---- group: Original Pass
brep_33 = Brep(<brep referenced from the Rhino model>)
debrep_15 = DeconstructBrep(Brep=brep_33)  # -> Faces, Edges, Vertices
boxprop_8 = BoxProperties(Box=brep_33)  # -> Center, Diagonal, Area, Volume, Degeneracy
division_13 = Division(A=boxprop_8.Volume, B=boxprop_8.Area)
division_14 = Division(A=division_13, B="2")
vec_7 = VectorXYZ(XComponent=0, YComponent=0, ZComponent=division_14)  # -> Vector, Length

# ---- group: Original Pass / Graft to add branch to align with other tree
move_9 = Move(Geometry=boxprop_8.Center, Motion=vec_7.Vector)  # -> Geometry, Transform

# ---- group: Original Pass (continued)
project_12 = ProjectPoint(Point=move_9.Geometry, Direction=Vector(0, 0, -1), Geometry=debrep_15.Faces)  # -> Point, Index
panel_112 = Panel(move_9.Geometry)
item_21 = ListItem(List=debrep_15.Faces, Index=project_12.Index, Wrap=True)
panel_113 = Panel(project_12.Index)
srf_15 = Surface(item_21)
edges_8 = BrepEdges(Brep=srf_15)  # -> graft(Naked), Interior, NonManifold

crv_18 = Curve(edges_8.Naked)
walls_4 = Walls(
    WriteToggle=toggle_10,
    FolderPath=panel_101,
    CsvFileName="core",
    Curves=crv_18,
    RevitTypeName="Core Wall",
    RevitWallHeight=item_19)  # -> Output, Data
panel_114 = Panel(walls_4.Data)
panel_115 = Panel(walls_4.Output)
